# Grasshopper definition processImage.gh (Grasshopper 0.9.76)
# plug-ins: Python Interpreter

number_slider = Slider(100, range=0..100)
dom = ConstructDomain(DomainStart=0, DomainEnd=100)
range = Range(Domain=dom, Steps="200")
range_2 = Range(Domain=dom, Steps="200")
pt = ConstructPoint(XCoordinate=graft(range_2), YCoordinate=range, ZCoordinate=0)  # -> simplify(flatten(Point))
addition = Addition(A="200", B=1)
partition = PartitionList(List=pt, Size=addition)
rev = ReverseList(List=partition)  # -> flatten(List)
image = ImageSampler(
    rev,
    FilePath="C:\Users\Administrator\Dropbox\Settlement\Archive\LandCover_All_20140619_7Color.png",
    Filter="Colour",
    Interpolate=False,
    Umax=100,
    Umin=0,
    Vmax=100,
    Vmin=0,
    Wrap=1)
panel = Panel("C:\Users\Administrator\Copy\development\SettlementEmerge\data\bitmapdata.json")
concat = Concatenate(FragmentA="C:\Users\Administrator\Dropbox\Public\D3TestData", FragmentB="\bitmapdata.json")
col = Colour(simplify(image))
lng = ListLength(List=range)
panel_2 = Panel("""#000000
#137484
#00A3DB
#9BD956
#E6385C
#F5EA0B
#3ECA66""")
txt = Text(col)
python = PythonScript(points=rev, colors=txt, numOfCol=lng, filepath=concat)  # -> out, selPts, row, col; inputs points: list of Point3d, colors: list, numOfCol: Int32; disabled
# ---------- python: Python ----------
import json
"""
colors_d = {"0,0,0" : "#000000",
"19,116,132" : "#137484",
"0,163,219" : "#00A3DB",
"155,217,86" : "#9BD956",
"230,56,92": "#E6385C",
"245,234,11" : "#F5EA0B",
"62,202,102" : "#3ECA66"}
"""

colors_d = {"0,0,0" : "none",
"19,116,132" : "Wetlands",
"0,163,219" : "Water",
"155,217,86" : "Natural",
"230,56,92": "Developed",
"245,234,11" : "Agriculture",
"62,202,102" : "Forest"}

row = []
col = []
selPts = []
data = {"numOfCol" : str(numOfCol),
        "cellArea" : "0.04",
        "cells" : []
        }
        
for i, pt in enumerate(points):
    landuse = colors_d[str(colors[i])]
    if landuse == "none": continue
    x = int(i/numOfCol)
    y = i%numOfCol
    row.append(y)
    col.append(x)
    selPts.append(pt)
    cell = { "id":i, "x":x, "y":y, "landuse":landuse}
    data["cells"].append(cell)


with open(filepath, "w") as outf:
    outf.write(json.dumps(data))
# ---------- end python ----------
location = Location(graft([Point(41.68403327, 12.24231564, 0), Point(81.30257099, 43.51843491, 0), Point(18.62301794, 39.54331683, 0), Point(45.84623676, 56.34129519, 0), Point(31.41763117, 46.64708472, 0), Point(30.72990428, 23.94732003, 0)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]))
cp = ClosestPoint(Point=location, Cloud=python.selPts)  # -> ClosestPoint, flatten(CPIndex), Distance
panel_3 = Panel("C:\Users\Administrator\Copy\development\SettlementEmerge\data\settlements.json")
item = ListItem(List=python.row, Index=cp.CPIndex, Wrap=False)  # -> flatten(Item)
item_2 = ListItem(List=python.col, Index=cp.CPIndex, Wrap=True)  # -> flatten(Item)
concat_2 = Concatenate(FragmentA="C:\Users\Administrator\Dropbox\Public\D3TestData", FragmentB="\settlements.json")
createjson = PythonScript(
    name=["Panama", "Cherry Creek", "Ripley", "Brocton", "Westfield", "Sharman", "Sincalirville", "Fredonia", "Cassadaga", "Chautauqua Institution", "Frewsburg", "Busti", "Kennedy", "Sunset Bay", "Forestville", "Dunkirk", "Silver Creek", "Falconer", "Celoron", "Bemus Point", "Mayville", "Lakewood", "Jamestown West", "Jamestown"],
    population=["4572", "5211", "2452", "5579", "4896", "4813", "4674", "11702", "4527", "3618", "5999", "4122", "4558", "637", "4790", "12836", "2035", "2619", "1686", "4457", "917", "3229", "1834", "31146"],
    filepath=concat_2,
    x=item_2,
    y=item)  # -> out; inputs name: list, population: list, x: list, y: list; disabled
# ---------- createjson: Python ----------
import json

settlements = [];
# "name":"some city name", "x":"25", "y": "200", "population":"200000"}

for i, city in enumerate(name):
    c = {
        "name": city,
        "x": x[i],
        "y": y[i],
        "population": population[i]
         }
    settlements.append(c)


with open(filepath, "w") as outf:
    outf.write(json.dumps(settlements))
# ---------- end createjson ----------
